# Grasshopper definition Example02_Movement_MultilayerAndMultitool.gh (Grasshopper 1.0.7)
# plug-ins: Vespidae

# ----
# 1. Import Geometry
# Here, we import two sets of curves
# from two different layers in Rhino.
pipeline = GeometryPipeline(
    GroupByLayer=False,
    GroupByType=False,
    IncludeHidden=True,
    IncludeLocked=True,
    LayerFilter="t0",
    NameFilter="*",
    SublayerFiltering=True,
    TypeFilter=4)
pipeline_2 = GeometryPipeline(
    GroupByLayer=False,
    GroupByType=False,
    IncludeHidden=True,
    IncludeLocked=True,
    LayerFilter="t1",
    NameFilter="*",
    SublayerFiltering=True,
    TypeFilter=4)

# ----
# 2. Convert to Move actions
# Each layer of curves has different parameters.
# In this case, different speeds and tools are used
# for each layer.
# The t0 layer has 2 Move
# actions, while t1 has 1 Move.
number_slider = Slider(1, range=0..100)
vespmove = MoveComponent(Curve=pipeline, Speed=Slider(6000, range=0..10000), ToolId=Slider(0, range=0..100))
vespmove_2 = MoveComponent(Curve=pipeline_2, Speed=Slider(3000, range=0..10000), ToolId=number_slider)
panel = Panel(vespmove_2)
panel_2 = Panel(vespmove)

# ----
# 3. Sort the Moves & Solve
# First, we merge all of the actions
# together into one stream of data.
# (3 Move actions total)
# We use the Vespidae SortActions to sort the curves
# based on their starting coordinate. We
# can choose which axis to sort on (XYZ).
# We can also choose to
# flip the sorting direction if we want the reverse.
# 
# NOTE: Currently tool is prioritized, so all actions with a single tool
# are complete before moving on to another tool.
# We then Solve to calculate the correct
# Travel actions between the sorted Move
# components.
merge = Merge(Data1=vespmove, Data2=vespmove_2)
# Example 2: Working with Curves in Multiple Layers
# In this example, we are working with curves that are in multiple layers in Rhino.
# We assign different parameters to the curves in each layer (in this case, speed).
# We then choose how we want to sort the Vespidae actions, and sort from there.
panel_3 = Panel(merge)
sortactions = SortActionsComponent(Actions=merge, SortType=Slider(1, range=0..2), Flip=Toggle(False))
retract_height_mm = Slider(5, range=0..30)
solve = SolveActionsComponent(Actions=sortactions, RetractHeight=retract_height_mm, TravelSpeed=5000, PartialRetract=False, SortCriteria=0)
panel_4 = Panel(solve)

# ----
# 3.5 Visualize
# This visualization section has a list function
# so that we can walk through the order that everything happens.
# Experiment with how changing the sort direction
# changes the order of motion!
step_in_toolpath = Slider(0, range=0..5)
viz_paths = VisualizePaths(Actions=solve, ArrowScl=10, ArrowDensity=0)  # -> AllMoves, Moves, Extrude, Travel, Arrows
item = ListItem(List=viz_paths.AllMoves, Index=step_in_toolpath, Wrap=True)
crv = Curve(item)

# ----
# 3. Sort the Moves & Solve
# This time, we add a footer at the end. This removes the tool
# and moves to the coordinates (150, 250).
panel_5 = Panel("""T-1 
G0 X150 Y250""")
vespidae_to_gcode = VespidaeGcode(Actions=solve, Footer=panel_5, Absolute=False)
send = Button()
upload_gcode = UploadGcodeComponent(Gcode=vespidae_to_gcode, Filename="example_02", Ip="http://192.168.0.10", SendCode=send)
panel_6 = Panel(vespidae_to_gcode)
