# Grasshopper definition example_00.gh (Grasshopper 1.0.7)
# plug-ins: Vespidae

# 1. Import Curves
# & sort
pipeline = GeometryPipeline(
    GroupByLayer=False,
    GroupByType=False,
    IncludeHidden=True,
    IncludeLocked=True,
    LayerFilter="Default",
    NameFilter="*",
    SublayerFiltering=True,
    TypeFilter=4)
sort_curves = SortCurveComponent(Curves=pipeline)
# 2. Convert to Vespidae
# Move Objects
vespmove = MoveComponent(Curve=sort_curves, Speed=Slider(7118, range=0..10000), ToolId="t0")
panel = Panel(vespmove)
# 3. Convert to Vespidae
# Move Objects
solve = SolveActionsComponent(
    Actions=vespmove,
    RetractHeight=Slider(14, range=0..100),
    TravelSpeed=Slider(8160, range=0..10000),
    PartialRetract=Toggle(False))
panel_2 = Panel(solve)
expose_paths = ExposePaths(Vespmo=solve, ArrowScl=Slider(1.9, range=0..10))  # -> AllMoves, AllTravel, Arrows
# 4. Convert to Gcode &
# Upload to Controller
vespmogcode = Vespmo_Gcode_Component(VESPMO=solve)
upload_gcode = UploadGcodeComponent(Gcode=vespmogcode, Filename="example_00", Ip="http://192.168.0.10", SendCode=Button())
