# Grasshopper definition example_01.gh (Grasshopper 1.0.7)
# plug-ins: Vespidae

number_slider = Slider(3, range=0..10)
crv = Curve(<curve referenced from the Rhino model>)
area = Area(Geometry=crv)  # -> Area, Centroid
xy = XYPlane(Origin=area.Centroid)
sqgrid = Square(Plane=xy, Size=Slider(14, range=0..100), ExtentX=number_slider, ExtentY=number_slider)  # -> Cells, Points
# test different settings on same curve
number_slider_2 = Slider(0.2, range=0..1)
vec2pt = Vector2Pt(PointA=area.Centroid, PointB=sqgrid.Points, Unitize=False)  # -> Vector, Length
move = Move(Geometry=crv, Motion=vec2pt.Vector)  # -> flatten(Geometry), Transform
lng = ListLength(List=flatten(move.Geometry))
series = Series(Start=0, Step=number_slider_2, Count=lng)  # -> flatten(Series)
vespextrusion = ExtrusionComponent(Curve=graft(move.Geometry), Extrusion=graft(series), Speed=1000, Temperature=205, ToolId="t0")
panel = Panel(vespextrusion)
panel_2 = Panel(series)
viewer = ParamViewer(vespextrusion)
solve = SolveActionsComponent(Actions=vespextrusion, RetractHeight=Slider(15, range=0..100))
vespmogcode = Vespmo_Gcode_Component(VESPMO=solve)
panel_3 = Panel(vespmogcode)
